vi "Run tests.gvi"   [LabVIEW NXG 3.1.0]
outputs:
  "pass?": bool
  "Errors": string[]
panel indicators:
  "error out": error
uses:
  Gregstoll::ProbabilityToFriendlyStringTests::Read test cases.gvi
  Gregstoll::ProbabilityToFriendlyString::Friendly probability.gtype::From double.gvi
  Gregstoll::ProbabilityToFriendlyString::Friendly probability.gtype::To string.gvi
diagram:
  call "Read test cases.gvi"() -> (test cases=w1, error out=w2)
  for {
    w3 = each element of w1
    Property Node(instance in=w3) -> ("Probability"=w6, "Expected Friendly Probability"=w7, "Line number"=w8)
    call "From double.gvi"(Probability=w6) -> (Friendly Probability out=w9, Error Out=w10)
    Is Equal[ComparisonMode=CompareAggregates](x=w7, y=w9) -> w11
    case (w11) {
      frame True {
        w12 = FALSE
        w13 = ""
      }
      frame False {
        call "To string.gvi"(Friendly Probability=w9) -> (string=w14)
        call "To string.gvi"(Friendly Probability=w7) -> (string=w15)
        Format Into String(formatString="expected %s actual %s for %f line number %d", w15, w14, w6, w8) -> w13
        w12 = TRUE
      }
    }
    append w10 to w4
    append w13 to w5 if w12
  }
  Merge Errors(w2, w4) -> (error out=w16)
  $"error out" <- w16
  Array Size(array=w5) -> (size(s)=w17)
  Is Greater Than 0(x=w17) -> w18
  Logical Or[output inverted](w16, w18) -> w19
  $"pass?" <- w19
  $Errors <- w5
